# Grasshopper definition GHBinaryWriter.gh (Grasshopper 1.0.7)
# plug-ins: ScriptParasite

mesh_sphere = MeshSphere(Base=PlaneXY(0, 0, 0), Radius=10, UCount=10, VCount=20)
triangulate = Triangulate(Mesh=mesh_sphere)  # -> Mesh, Count

file_path = FilePath("L:\source\repos\GHBinaryWriter\")
c_script = CSharpScript(MeshInput=triangulate.Mesh)  # -> Out, A
script_parasite = ScriptParasite(Enable=Toggle(True), Folder=file_path)

panel = Panel(c_script.Out)
